% Simulink data dictionary ModelParameter.sldd

Filter_Lenth = Simulink.Parameter(24, DataType="uint32")  % 滤波器的长度
RefMic = Simulink.Signal(DataType="single")
ErrorMic = Simulink.Signal(DataType="single")
ErrorSignal = Simulink.Signal(DataType="single")
RefSignal = Simulink.Signal(DataType="single")
SpeakerOut = Simulink.Signal(DataType="single")
SourceOut = Simulink.Signal(DataType="single")
Sampling_rate = Simulink.Parameter(1000, DataType="double")  % 采样率